# Grasshopper definition strategy 44 with sun analysis.gh (Grasshopper 1.0.7)

# ---- group: Levels
number_slider = Slider(10, range=0..10)

# ----
cluster = Cluster_5(
    count=number_slider,
    count_2=number_slider,
    count_3=number_slider,
    count_4=number_slider,
    count_5=number_slider,
    count_6=number_slider,
    count_7=number_slider,
    count_8=number_slider)  # -> i, i_2, i_3, i_4, i_5, result, i_6, i_7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

# ---- group: North location
number_slider_2 = Slider(-276, range=-360..360)

# ----
number = Number([0.001161495505, 0.001150626121, 0.001182623687, 0.001164835515, 0.001163856114, 0.00112741407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])
number_2 = Number([8, 4, 7, 5, 6, 2, 6, 5, 5, 2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])
number_3 = Number([0.66, 0.37, 0.44, 0.65, 0.55, 0.79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])
number_4 = Number([0.42, 0.73, 0.54, 0.47, 0.67, 0.45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])
number_5 = Number([8, 6, 7, 2, 2, 2, 4, 3, 7, 2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])
number_6 = Number([6, 3, 4, 7, 3, 4, 7, 3, 2, 4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])
number_7 = Number([0.45, 0.68, 0.44, 0.54, 0.66, 0.76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])
number_8 = Number([0.54, 0.81, 0.85, 0.73, 0.73, 0.8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])
number_9 = Number([0.44, 0.71, 0.52, 0.46, 0.41, 0.79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])
number_10 = Number([0.54, 0.78, 0.43, 0.46, 0.37, 0.87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])
number_11 = Number([4, 4, 3, 4, 2, 3, 3, 3, 1, 4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])
number_12 = Number([0.4, 0.35, 0.36, 0.33, 0.39, 0.36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])
sort_list = SortList(
    Keys=number,
    ValuesValuesA=number_2,
    ValuesA=number_3,
    ValuesB=number_4,
    ValuesC=number_5,
    ValuesD=number_8,
    ValuesE=number_9,
    ValuesF=number_6,
    ValuesG=number_7,
    ValuesH=number_10,
    ValuesI=number_11,
    ValuesJ=number_12)  # -> Keys, ValuesValuesA, ValuesA, ValuesB, ValuesC, ValuesD, ValuesE, ValuesF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
number_slider_3 = Slider(630, range=471..671)
list_item = ListItem(List=sort_list.ValuesValuesA, Index=number_slider_3, Wrap=True)
list_item_2 = ListItem(List=sort_list.ValuesA, Index=number_slider_3, Wrap=True)
list_item_3 = ListItem(List=sort_list.ValuesC, Index=number_slider_3, Wrap=True)
list_item_4 = ListItem(List=sort_list.ValuesE, Index=number_slider_3, Wrap=True)
list_item_5 = ListItem(List=sort_list.ValuesB, Index=number_slider_3, Wrap=True)
list_item_6 = ListItem(List=sort_list.ValuesD, Index=number_slider_3, Wrap=True)
list_item_7 = ListItem(List=sort_list.ValuesF, Index=number_slider_3, Wrap=True)
list_item_8 = ListItem(List=sort_list.ValuesH, Index=number_slider_3, Wrap=True)
list_item_9 = ListItem(List=sort_list.ValuesG, Index=number_slider_3, Wrap=True)
list_item_10 = ListItem(List=sort_list.ValuesI, Index=number_slider_3, Wrap=True)
list_item_11 = ListItem(List=sort_list.ValuesJ, Index=number_slider_3, Wrap=True)
cluster_2 = Cluster_11(
    relay=[cluster.i, cluster.i_5, cluster.i_8, cluster.i_11, cluster.i_14, cluster.i_16, cluster.i_18],
    index=list_item,
    scale_x=list_item_2,
    scale_y=list_item_5,
    index_2=list_item_3,
    relay_2=[cluster.i_3, cluster.i_4],
    scale_y_2=list_item_4,
    scale_z=list_item_6,
    relay_5=cluster.result,
    index_3=list_item_7,
    scale_x_2=list_item_8,
    relay_3=[cluster.i_7, cluster.i_9, cluster.i_10, cluster.i_12, cluster.i_13],
    scale_y_3=list_item_8,
    scale_z_2=list_item_9,
    index_4=list_item_10,
    scale_x_3=list_item_11,
    relay_4=[cluster.i_2, cluster.i_6, cluster.i_15, cluster.i_17, cluster.i_19])  # -> geometry, result, geometry_3, relay_6, geometry_5, geometry_4, geometry_2
area = Area(Geometry=cluster_2.geometry_2)  # -> Area, Centroid
area_2 = Area(Geometry=cluster_2.geometry_4)  # -> Area, Centroid
area_3 = Area(Geometry=cluster_2.geometry)  # -> Area, Centroid
area_4 = Area(Geometry=cluster_2.geometry_3)  # -> Area, Centroid
panel = Panel(area.Area)
panel_2 = Panel(area_2.Area)
panel_3 = Panel(area_3.Area)
panel_4 = Panel(area_4.Area)
mass_addition = MassAddition(Input=area_3.Area)  # -> Result, PartialResults
mass_addition_2 = MassAddition(Input=area_2.Area)  # -> Result, PartialResults
mass_addition_3 = MassAddition(Input=area.Area)  # -> Result, PartialResults
mass_addition_4 = MassAddition(Input=area_4.Area)  # -> Result, PartialResults
panel_5 = Panel(mass_addition.Result)
panel_6 = Panel(mass_addition_2.Result)
panel_7 = Panel(mass_addition_3.Result)
panel_8 = Panel(mass_addition_4.Result)
cluster_3 = Cluster(
    north=number_slider_2,
    geometry=cluster_2.result,
    start_month=Slider(1, range=1..12),
    run=Toggle(True),
    start_day=Slider(1, range=1..30),
    start_hour=Slider(1, range=0..23),
    end_month=Slider(12, range=1..12),
    end_day=Slider(30, range=1..30),
    end_hour=Slider(23, range=0..23))
panel_9 = Panel(cluster_3)
mass_addition_5 = MassAddition(Input=[mass_addition.Result, mass_addition_4.Result, mass_addition_2.Result, mass_addition_3.Result])  # -> Result, PartialResults
panel_10 = Panel(mass_addition_5.Result)
division = Division(A=cluster_3, B=mass_addition_5.Result)
merge = Merge(Data1=cluster_2.geometry_5, Data2=cluster_2.relay_6)
data_recorder = DataRecorder(division, DataLimit=-10, RecordData=True)
list_item_12 = ListItem(List=sort_list.Keys, Index=number_slider_3, Wrap=True)

# ==== cluster Cluster
panel = Panel("http://climate.onebuilding.org/WMO_Region_6_Europe/GBR_United_Kingdom/ENG_England/GBR_ENG_Leavesden.037815_TMYx.zip")
downloadepw = LBDownloadWeather(weather_URL=panel)  # -> epw_file, stat_file, ddy_file; plug-in component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
importloc = LBImportLocation(epw_file=downloadepw.epw_file)  # -> location; plug-in component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
importepw = LBImportEPW(epw_file=downloadepw.epw_file)  # -> location, dry_bulb_temperature, dew_point_temperature, relative_humidity, wind_speed, wind_direction, direct_normal_rad, diffuse_horizontal_rad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; plug-in component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
start_month = ClusterInput()
start_day = ClusterInput()
start_hour = ClusterInput()
end_month = ClusterInput()
end_day = ClusterInput()
end_hour = ClusterInput()
analysisperiod = LBAnalysisPeriod(
    start_month=start_month,
    start_day=start_day,
    start_hour=start_hour,
    end_month=end_month,
    end_day=end_day,
    end_hour=end_hour)  # -> period, hoys, dates; plug-in component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
north = ClusterInput()
skymatrix = LBCumulativeSkyMatrix(
    north=north,
    location=importloc,
    direct_rad=importepw.direct_normal_rad,
    diffuse_rad=importepw.diffuse_horizontal_rad,
    hoys=analysisperiod.hoys)  # -> out, sky_mtx; plug-in component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
geometry = ClusterInput()
run = ClusterInput()
incidentradiation = LBIncidentRadiation(
    sky_mtx=skymatrix.sky_mtx,
    geometry=flatten(geometry),
    grid_size=Slider(1000, range=0..1000),
    offset_dist=Slider(20, range=0..100),
    run=run)  # -> out, points, results, total, mesh, legend, title, int_mtx; plug-in component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
total = ClusterOutput(incidentradiation.total)

# ==== cluster Cluster_5
count = ClusterInput()
count_2 = ClusterInput()
count_3 = ClusterInput()
count_4 = ClusterInput()
count_5 = ClusterInput()
count_6 = ClusterInput()
count_7 = ClusterInput()
count_8 = ClusterInput()
cluster = Cluster_2(
    count_5=count,
    count=count_2,
    count_7=count_3,
    count_3=count_4,
    count_4=count_5,
    count_2=count_6,
    count_6=count_7,
    count_8=count_8)  # -> list_a_3, list_b, list_b_4, list_b_2, list_a_2, list_a, list_b_3, list_b_5
cluster_2 = Cluster_3(
    geometry_7=cluster.list_a_3,
    geometry_8=cluster.list_a,
    geometry_4=cluster.list_b_4,
    geometry_2=cluster.list_a_2,
    geometry=cluster.list_b,
    geometry_5=cluster.list_b_2,
    geometry_6=cluster.list_b_3,
    geometry_3=cluster.list_b_5)  # -> result, geometry_22, geometry_23, geometry_19, geometry_17, geometry_20, geometry_21, geometry_18
result = ClusterOutput(cluster_2.result)
cluster_3 = Cluster_4(
    group_2=cluster_2.geometry_22,
    group_4=cluster_2.geometry_23,
    group=cluster_2.geometry_19,
    relay=cluster_2.geometry_17,
    group_3=cluster_2.geometry_20,
    group_5=cluster_2.geometry_21,
    group_6=cluster_2.geometry_18)  # -> i_5, i_3, i_2, i, i_12, i_9, i_7, i_8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
i = ClusterOutput(cluster_3.i_5)
i_2 = ClusterOutput(cluster_3.i_3)
i_3 = ClusterOutput(cluster_3.i_2)
i_4 = ClusterOutput(cluster_3.i)
i_5 = ClusterOutput(cluster_3.i_12)
i_6 = ClusterOutput(cluster_3.i_9)
i_7 = ClusterOutput(cluster_3.i_7)
i_8 = ClusterOutput(cluster_3.i_8)
i_9 = ClusterOutput(cluster_3.i_6)
i_10 = ClusterOutput(cluster_3.i_4)
i_11 = ClusterOutput(cluster_3.i_13)
i_12 = ClusterOutput(cluster_3.i_11)
i_13 = ClusterOutput(cluster_3.i_10)
i_14 = ClusterOutput(cluster_3.i_15)
i_15 = ClusterOutput(cluster_3.i_14)
i_16 = ClusterOutput(cluster_3.i_17)
i_17 = ClusterOutput(cluster_3.i_16)
i_18 = ClusterOutput(cluster_3.i_19)
i_19 = ClusterOutput(cluster_3.i_18)

# ==== cluster Cluster_11
relay = ClusterInput()
index = ClusterInput()
scale_x = ClusterInput()
scale_y = ClusterInput()
index_2 = ClusterInput()
relay_2 = ClusterInput()
scale_y_2 = ClusterInput()
scale_z = ClusterInput()
index_3 = ClusterInput()
scale_x_2 = ClusterInput()
relay_3 = ClusterInput()
scale_y_3 = ClusterInput()
scale_z_2 = ClusterInput()
index_4 = ClusterInput()
scale_x_3 = ClusterInput()
relay_4 = ClusterInput()
relay_5 = ClusterInput()
cluster = Cluster_6(relay=relay, index=index, scale_x=scale_x, scale_y=scale_y)
geometry = ClusterOutput(cluster)
cluster_2 = Cluster_9(index=index_4, scale_x=scale_x_3, relay=relay_4)
geometry_2 = ClusterOutput(cluster_2)
cluster_3 = Cluster_7(index=index_2, relay=relay_2, scale_y=scale_y_2, scale_z=scale_z)
geometry_3 = ClusterOutput(cluster_3)
cluster_4 = Cluster_8(index=index_3, scale_x=scale_x_2, relay=relay_3, scale_y=scale_y_3, scale_z=scale_z_2)
geometry_4 = ClusterOutput(cluster_4)
merge = Merge(Data1=cluster, Data2=cluster_3, Data3=cluster_4, Data4=cluster_2)
cluster_5 = Cluster_10(geometry=merge, relay=relay_5)  # -> geometry_2, relay_2, geometry_3
relay_6 = ClusterOutput(cluster_5.relay_2)
geometry_5 = ClusterOutput(cluster_5.geometry_3)
solid_union = SolidUnion(Breps=[merge, cluster_5.geometry_2])
result = ClusterOutput(solid_union)

# ==== cluster Cluster_2
curve = Curve(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)
number_slider = Slider(3, range=0..10)
boundary_surfaces = BoundarySurfaces(Edges=curve)
quad_panels = QuadPanels(Surface=boundary_surfaces, UDivisions=number_slider, VDivisions=number_slider)
list_item = ListItem(List=quad_panels, Index=0, Wrap=True)
list_item_2 = ListItem(List=quad_panels, Index=0, Wrap=True)
unit_z = UnitZ(Factor=expr("-310", 310))
geometry = Geometry(<brep referenced from the Rhino model>)
geometry_2 = Geometry(<brep referenced from the Rhino model>)
geometry_3 = Geometry(<brep referenced from the Rhino model>)
geometry_4 = Geometry(<brep referenced from the Rhino model>)
geometry_5 = Geometry(<brep referenced from the Rhino model>)
geometry_6 = Geometry(<brep referenced from the Rhino model>)
geometry_7 = Geometry(<brep referenced from the Rhino model>)
geometry_8 = Geometry(<brep referenced from the Rhino model>)
geometry_9 = Geometry(<brep referenced from the Rhino model>)
geometry_10 = Geometry(<brep referenced from the Rhino model>)
geometry_11 = Geometry(<brep referenced from the Rhino model>)
geometry_12 = Geometry(<brep referenced from the Rhino model>)
geometry_13 = Geometry(<brep referenced from the Rhino model>)
geometry_14 = Geometry(<brep referenced from the Rhino model>)
quad_panels_2 = QuadPanels(Surface=list_item_2, UDivisions="2", VDivisions="1")
group = Group(Objects=[geometry, geometry_2, geometry_3, geometry_4])
group_2 = Group(Objects=[geometry_5, geometry_6, geometry_7, geometry_8])
group_3 = Group(Objects=[geometry_9, geometry_11, geometry_12, geometry_13, geometry_14, geometry_10])
bounding_box = BoundingBox(Content=group, Plane=PlaneXY(0, 0, 0))  # -> Box, Box_2
list_item_3 = ListItem(List=quad_panels_2, Index=0, Wrap=True)
list_item_4 = ListItem(List=quad_panels, Index=3, Wrap=True)
bounding_box_2 = BoundingBox(Content=group_3, Plane=PlaneXY(0, 0, 0))  # -> Box, Box_2
bounding_box_3 = BoundingBox(Content=group_2, Plane=PlaneXY(0, 0, 0))  # -> Box, Box_2
deconstruct_brep = DeconstructBrep(Brep=bounding_box.Box)  # -> Faces, Edges, Vertices
deconstruct_brep_2 = DeconstructBrep(Brep=list_item_3)  # -> Faces, Edges, Vertices
deconstruct_brep_3 = DeconstructBrep(Brep=bounding_box_3.Box)  # -> Faces, Edges, Vertices
deconstruct_brep_4 = DeconstructBrep(Brep=bounding_box_2.Box)  # -> Faces, Edges, Vertices
quad_panels_3 = QuadPanels(Surface=list_item_4, UDivisions="2", VDivisions="1")
surface = Surface(quad_panels_3)
move = Move(Geometry=surface, Motion=unit_z)  # -> Geometry, Transform
deconstruct_brep_5 = DeconstructBrep(Brep=move.Geometry)  # -> Faces, Edges, flatten(Vertices)
list_item_5 = ListItem(List=deconstruct_brep_5.Vertices, Index=0, Wrap=True)  # -> Item, Item1, Item2, Item3, Item4, Item5, Item6
list_item_6 = ListItem(List=deconstruct_brep.Faces, Index=0, Wrap=True)  # -> Item, Item1, Item2, Item3, Item4, Item5
_4point_surface = _4PointSurface(CornerA=list_item_5.Item, CornerB=list_item_5.Item3, CornerC=list_item_5.Item6, CornerD=list_item_5.Item5)
list_item_7 = ListItem(List=quad_panels, Index=expr("6", 0), Wrap=True)
list_item_8 = ListItem(List=quad_panels, Index=expr("6", 0), Wrap=True)
list_item_9 = ListItem(List=quad_panels_2, Index=expr("1", 0), Wrap=True)
list_item_10 = ListItem(List=quad_panels_3, Index=0, Wrap=True)  # -> Item, Item1
list_item_11 = ListItem(List=deconstruct_brep_3.Faces, Index=0, Wrap=True)  # -> Item, Item1, Item2, Item3, Item4, Item5
surface_2 = Surface(list_item_6.Item5)
list_item_12 = ListItem(List=deconstruct_brep_4.Faces, Index=0, Wrap=True)  # -> Item, Item1, Item2, Item3, Item4, Item5
deconstruct_brep_6 = DeconstructBrep(Brep=list_item_10.Item)  # -> Faces, Edges, Vertices
deconstruct_brep_7 = DeconstructBrep(Brep=list_item_9)  # -> Faces, Edges, Vertices
surface_3 = Surface(list_item_11.Item4)
surface_4 = Surface(list_item_10.Item1)
sporph = Sporph(Geometry=group, Base=surface_2, Parameter=null, Target=list_item_3, Parameter_2=null, Preserve=False, Quick=False)
quad_panels_4 = QuadPanels(Surface=list_item_8, UDivisions="2", VDivisions="1")
sporph_2 = Sporph(
    Geometry=group_3,
    Base=list_item_12.Item5,
    Parameter=null,
    Target=list_item,
    Parameter_2=null,
    Preserve=False,
    Quick=False)
list_item_13 = ListItem(List=deconstruct_brep_6.Vertices, Index=0, Wrap=True)  # -> Item, Item1, Item2
list_item_14 = ListItem(List=deconstruct_brep_7.Vertices, Index=0, Wrap=True)  # -> Item, Item1, Item2, Item3
sporph_3 = Sporph(
    Geometry=group_3,
    Base=list_item_12.Item5,
    Parameter=null,
    Target=list_item_7,
    Parameter_2=null,
    Preserve=False,
    Quick=False)
sporph_4 = Sporph(Geometry=group, Base=surface_2, Parameter=null, Target=surface_4, Parameter_2=null, Preserve=False, Quick=False)
_4point_surface_2 = _4PointSurface(CornerA=list_item_13.Item1, CornerB=list_item_13.Item2, CornerC=list_item_14.Item3, CornerD=list_item_14.Item)
list_item_15 = ListItem(List=quad_panels_4, Index=0, Wrap=True)  # -> Item, Item1
count = ClusterInput()
sporph_5 = Sporph(Geometry=group_2, Base=surface_3, Parameter=null, Target=_4point_surface, Parameter_2=null, Preserve=False, Quick=False)
count_2 = ClusterInput()
count_3 = ClusterInput()
count_4 = ClusterInput()
unit_z_2 = UnitZ(Factor="310")
linear_array = LinearArray(Geometry=sporph, Direction=unit_z_2, Count=count)  # -> Geometry, Transform
linear_array_2 = LinearArray(Geometry=sporph_3, Direction=unit_z_2, Count=count_2)  # -> Geometry, Transform
linear_array_3 = LinearArray(Geometry=sporph_4, Direction=unit_z_2, Count=count_3)  # -> Geometry, Transform
linear_array_4 = LinearArray(Geometry=sporph_5, Direction=unit_z_2, Count=count_4)  # -> Geometry, Transform
sporph_6 = Sporph(
    Geometry=group_2,
    Base=surface_3,
    Parameter=null,
    Target=_4point_surface_2,
    Parameter_2=null,
    Preserve=False,
    Quick=False)
count_5 = ClusterInput()
sporph_7 = Sporph(Geometry=group, Base=surface_2, Parameter=null, Target=list_item_15.Item, Parameter_2=null, Preserve=False, Quick=False)
sporph_8 = Sporph(Geometry=group, Base=surface_2, Parameter=null, Target=list_item_15.Item1, Parameter_2=null, Preserve=False, Quick=False)
dispatch = Dispatch(List=linear_array.Geometry, DispatchPattern=[True, False])  # -> ListA, ListB
linear_array_5 = LinearArray(Geometry=sporph_2, Direction=unit_z_2, Count=count_5)  # -> Geometry, Transform
dispatch_2 = Dispatch(List=linear_array_2.Geometry, DispatchPattern=[True, False])  # -> ListA, ListB
count_6 = ClusterInput()
count_7 = ClusterInput()
dispatch_3 = Dispatch(List=linear_array_3.Geometry, DispatchPattern=[True, False])  # -> ListA, ListB
count_8 = ClusterInput()
dispatch_4 = Dispatch(List=linear_array_4.Geometry, DispatchPattern=[True, False])  # -> ListA, ListB
linear_array_6 = LinearArray(Geometry=sporph_7, Direction=unit_z_2, Count=count_6)  # -> Geometry, Transform
list_b = ClusterOutput(dispatch.ListB)
linear_array_7 = LinearArray(Geometry=sporph_6, Direction=unit_z_2, Count=count_7)  # -> Geometry, Transform
list_a = ClusterOutput(dispatch_2.ListA)
dispatch_5 = Dispatch(List=linear_array_5.Geometry, DispatchPattern=[True, False])  # -> ListA, ListB
linear_array_8 = LinearArray(Geometry=sporph_8, Direction=unit_z_2, Count=count_8)  # -> Geometry, Transform
list_b_2 = ClusterOutput(dispatch_3.ListB)
list_a_2 = ClusterOutput(dispatch_4.ListA)
list_a_3 = ClusterOutput(dispatch_5.ListA)
dispatch_6 = Dispatch(List=linear_array_6.Geometry, DispatchPattern=[True, False])  # -> ListA, ListB
dispatch_7 = Dispatch(List=linear_array_7.Geometry, DispatchPattern=[True, False])  # -> ListA, ListB
dispatch_8 = Dispatch(List=linear_array_8.Geometry, DispatchPattern=[True, False])  # -> ListA, ListB
list_b_3 = ClusterOutput(dispatch_6.ListB)
list_b_4 = ClusterOutput(dispatch_7.ListB)
list_b_5 = ClusterOutput(dispatch_8.ListB)

# ==== cluster Cluster_3
geometry = ClusterInput()
geometry_2 = ClusterInput()
geometry_3 = ClusterInput()
geometry_4 = ClusterInput()
geometry_5 = ClusterInput()
geometry_6 = ClusterInput()
geometry_7 = ClusterInput()
geometry_8 = ClusterInput()

# ---- group: 1 bed
geometry_9 = Geometry(geometry)

# ---- group: 2 bed
geometry_10 = Geometry(geometry_2)

# ---- group: 1 bed
geometry_11 = Geometry(geometry_3)

# ---- group: 2 bed
geometry_12 = Geometry(geometry_4)

# ---- group: 1 bed
geometry_13 = Geometry(geometry_5)

geometry_14 = Geometry(geometry_6)

# ---- group: 3 bed
geometry_15 = Geometry(geometry_7)

geometry_16 = Geometry(geometry_8)

# ----
geometry_17 = ClusterOutput(geometry_10)
geometry_18 = ClusterOutput(geometry_11)
geometry_19 = ClusterOutput(geometry_12)
geometry_20 = ClusterOutput(geometry_13)
geometry_21 = ClusterOutput(geometry_14)
geometry_22 = ClusterOutput(geometry_15)
geometry_23 = ClusterOutput(geometry_16)
custom_preview = CustomPreview(Geometry=geometry_11, Material=ColourSwatch(SwatchColor=RGB(130, 90, 255)))
custom_preview_2 = CustomPreview(Geometry=geometry_13, Material=ColourSwatch(SwatchColor=RGB(130, 90, 255)))
custom_preview_3 = CustomPreview(Geometry=geometry_14, Material=ColourSwatch(SwatchColor=RGB(130, 90, 255)))
custom_preview_4 = CustomPreview(Geometry=geometry_15, Material=ColourSwatch(SwatchColor=RGB(193, 208, 255)))
custom_preview_5 = CustomPreview(Geometry=geometry_9, Material=ColourSwatch(SwatchColor=RGB(164, 136, 255)))
custom_preview_6 = CustomPreview(Geometry=geometry_12, Material=ColourSwatch(SwatchColor=RGB(164, 136, 255)))
custom_preview_7 = CustomPreview(Geometry=geometry_16, Material=ColourSwatch(SwatchColor=RGB(193, 208, 255)))
custom_preview_8 = CustomPreview(Geometry=geometry_10, Material=ColourSwatch(SwatchColor=RGB(164, 136, 255)))
merge = Merge(
    Data1=geometry_15,
    Data2=geometry_16,
    Data3=geometry_12,
    Data4=geometry_10,
    Data5=geometry_9,
    Data6=geometry_13,
    Data7=geometry_14,
    Data8=geometry_11)
result = ClusterOutput(merge)

# ==== cluster Cluster_4
relay = ClusterInput()
group = ClusterInput()
group_2 = ClusterInput()
group_3 = ClusterInput()
group_4 = ClusterInput()
ungroup = Ungroup(Group=group)
ungroup_2 = Ungroup(Group=relay)
ungroup_3 = Ungroup(Group=group_2)
ungroup_4 = Ungroup(Group=group_3)
group_5 = ClusterInput()
ungroup_5 = Ungroup(Group=group_4)
group_6 = ClusterInput()
ungroup_6 = Ungroup(Group=group_5)
ungroup_7 = Ungroup(Group=group_6)

# ---- group: Hall
list_item = ListItem(List=ungroup_3, Index=0, Wrap=True)
deconstruct_brep = DeconstructBrep(Brep=list_item)  # -> Faces, Edges, Vertices
list_item_2 = ListItem(List=deconstruct_brep.Faces, Index=expr("2", 0), Wrap=True)

# ---- group: bed
list_item_3 = ListItem(List=ungroup_3, Index=expr("3", 4), Wrap=True)
deconstruct_brep_2 = DeconstructBrep(Brep=list_item_3)  # -> Faces, Edges, Vertices
list_item_4 = ListItem(List=deconstruct_brep_2.Faces, Index=expr("3", 4), Wrap=True)

list_item_5 = ListItem(List=ungroup_3, Index=4, Wrap=True)
deconstruct_brep_3 = DeconstructBrep(Brep=list_item_5)  # -> Faces, Edges, Vertices
list_item_6 = ListItem(List=deconstruct_brep_3.Faces, Index=expr("0", 4), Wrap=True)

# ---- group: bed balcony
list_item_7 = ListItem(List=ungroup_3, Index=2, Wrap=True)
deconstruct_brep_4 = DeconstructBrep(Brep=list_item_7)  # -> Faces, Edges, Vertices
list_item_8 = ListItem(List=deconstruct_brep_4.Faces, Index=expr("2", 0), Wrap=True)

# ---- group: Hall
list_item_9 = ListItem(List=ungroup, Index=0, Wrap=True)
deconstruct_brep_5 = DeconstructBrep(Brep=list_item_9)  # -> Faces, Edges, Vertices
list_item_10 = ListItem(List=deconstruct_brep_5.Faces, Index=expr("2", 0), Wrap=True)

# ---- group: bed
list_item_11 = ListItem(List=ungroup, Index=3, Wrap=True)
deconstruct_brep_6 = DeconstructBrep(Brep=list_item_11)  # -> Faces, Edges, Vertices
list_item_12 = ListItem(List=deconstruct_brep_6.Faces, Index=expr("1", 5), Wrap=True)

# ---- group: Hall
list_item_13 = ListItem(List=ungroup_5, Index=0, Wrap=True)
deconstruct_brep_7 = DeconstructBrep(Brep=list_item_13)  # -> Faces, Edges, Vertices
list_item_14 = ListItem(List=deconstruct_brep_7.Faces, Index=expr("2", 0), Wrap=True)

# ---- group: bed
list_item_15 = ListItem(List=ungroup, Index=2, Wrap=True)
deconstruct_brep_8 = DeconstructBrep(Brep=list_item_15)  # -> Faces, Edges, Vertices
list_item_16 = ListItem(List=deconstruct_brep_8.Faces, Index=expr("2", 0), Wrap=True)

list_item_17 = ListItem(List=ungroup_5, Index=4, Wrap=True)
deconstruct_brep_9 = DeconstructBrep(Brep=list_item_17)  # -> Faces, Edges, Vertices
list_item_18 = ListItem(List=deconstruct_brep_9.Faces, Index=expr("1", 5), Wrap=True)

# ---- group: Hall
list_item_19 = ListItem(List=ungroup_2, Index=0, Wrap=True)
deconstruct_brep_10 = DeconstructBrep(Brep=list_item_19)  # -> Faces, Edges, Vertices
list_item_20 = ListItem(List=deconstruct_brep_10.Faces, Index=expr("2", 0), Wrap=True)

# ---- group: bed balcony
list_item_21 = ListItem(List=ungroup_5, Index=2, Wrap=True)
deconstruct_brep_11 = DeconstructBrep(Brep=list_item_21)  # -> Faces, Edges, Vertices
list_item_22 = ListItem(List=deconstruct_brep_11.Faces, Index=expr("2", 0), Wrap=True)

# ---- group: bed
list_item_23 = ListItem(List=ungroup_2, Index=3, Wrap=True)
deconstruct_brep_12 = DeconstructBrep(Brep=list_item_23)  # -> Faces, Edges, Vertices
list_item_24 = ListItem(List=deconstruct_brep_12.Faces, Index=expr("1", 5), Wrap=True)

list_item_25 = ListItem(List=ungroup_2, Index=2, Wrap=True)
deconstruct_brep_13 = DeconstructBrep(Brep=list_item_25)  # -> Faces, Edges, Vertices
list_item_26 = ListItem(List=deconstruct_brep_13.Faces, Index=expr("2", 0), Wrap=True)

# ---- group: Hall
list_item_27 = ListItem(List=ungroup_4, Index=0, Wrap=True)
deconstruct_brep_14 = DeconstructBrep(Brep=list_item_27)  # -> Faces, Edges, Vertices
list_item_28 = ListItem(List=deconstruct_brep_14.Faces, Index=expr("1", 1), Wrap=True)

# ---- group: bed balcony
list_item_29 = ListItem(List=ungroup_4, Index=expr("5", 2), Wrap=True)
deconstruct_brep_15 = DeconstructBrep(Brep=list_item_29)  # -> Faces, Edges, Vertices
list_item_30 = ListItem(List=deconstruct_brep_15.Faces, Index=expr("1", 0), Wrap=True)

# ---- group: Hall
list_item_31 = ListItem(List=ungroup_6, Index=0, Wrap=True)
deconstruct_brep_16 = DeconstructBrep(Brep=list_item_31)  # -> Faces, Edges, Vertices
list_item_32 = ListItem(List=deconstruct_brep_16.Faces, Index=expr("1", 1), Wrap=True)

# ---- group: bed balcony
list_item_33 = ListItem(List=ungroup_6, Index=expr("5", 2), Wrap=True)
deconstruct_brep_17 = DeconstructBrep(Brep=list_item_33)  # -> Faces, Edges, Vertices
list_item_34 = ListItem(List=deconstruct_brep_17.Faces, Index=expr("1", 0), Wrap=True)

# ---- group: Hall
list_item_35 = ListItem(List=ungroup_7, Index=0, Wrap=True)
deconstruct_brep_18 = DeconstructBrep(Brep=list_item_35)  # -> Faces, Edges, Vertices
list_item_36 = ListItem(List=deconstruct_brep_18.Faces, Index=expr("1", 1), Wrap=True)

# ---- group: bed balcony
list_item_37 = ListItem(List=ungroup_7, Index=expr("5", 2), Wrap=True)
deconstruct_brep_19 = DeconstructBrep(Brep=list_item_37)  # -> Faces, Edges, Vertices
list_item_38 = ListItem(List=deconstruct_brep_19.Faces, Index=expr("1", 0), Wrap=True)

# ----
i = ClusterOutput(list_item_4)
i_2 = ClusterOutput(list_item_6)
i_3 = ClusterOutput(list_item_8)
i_4 = ClusterOutput(list_item_12)
i_5 = ClusterOutput(list_item_2)
i_6 = ClusterOutput(list_item_16)
i_7 = ClusterOutput(list_item_18)
i_8 = ClusterOutput(list_item_10)
i_9 = ClusterOutput(list_item_22)
i_10 = ClusterOutput(list_item_24)
i_11 = ClusterOutput(list_item_26)
i_12 = ClusterOutput(list_item_14)
i_13 = ClusterOutput(list_item_20)
i_14 = ClusterOutput(list_item_30)
i_15 = ClusterOutput(list_item_28)
i_16 = ClusterOutput(list_item_34)
i_17 = ClusterOutput(list_item_32)
i_18 = ClusterOutput(list_item_38)
i_19 = ClusterOutput(list_item_36)

# ==== cluster Cluster_6
relay = ClusterInput()
index = ClusterInput()
scale_x = ClusterInput()
scale_y = ClusterInput()

# ---- group: type A toilets
deconstruct_brep = DeconstructBrep(Brep=flatten(relay))  # -> Faces, Edges, Vertices
list_item = ListItem(List=deconstruct_brep.Edges, Index=0, Wrap=True)  # -> Item, Item1, Item2, Item3
curve_middle = CurveMiddle(Curve=list_item.Item1)
curve_middle_2 = CurveMiddle(Curve=list_item.Item3)
line = Line(StartPoint=curve_middle, EndPoint=curve_middle_2)
divide_curve = DivideCurve(Curve=line, Count=10, Kinks=False)  # -> Points, Tangents, Parameters
list_item_2 = ListItem(List=divide_curve.Points, Index=index, Wrap=True)
xz_plane = XZPlane(Origin=list_item_2)
scale_nu = ScaleNU(Geometry=flatten(relay), Plane=flatten(xz_plane), ScaleX=scale_x, ScaleY=scale_y, ScaleZ=1)  # -> Geometry, Transform

# ----
geometry = ClusterOutput(scale_nu.Geometry)

# ==== cluster Cluster_7
relay = ClusterInput()
index = ClusterInput()
scale_y = ClusterInput()
scale_z = ClusterInput()

# ---- group: type A toilets
deconstruct_brep = DeconstructBrep(Brep=flatten(relay))  # -> Faces, Edges, Vertices
list_item = ListItem(List=deconstruct_brep.Edges, Index=0, Wrap=True)  # -> Item, Item1, Item2, Item3
curve_middle = CurveMiddle(Curve=list_item.Item1)
curve_middle_2 = CurveMiddle(Curve=list_item.Item3)
line = Line(StartPoint=curve_middle, EndPoint=curve_middle_2)
divide_curve = DivideCurve(Curve=line, Count=10, Kinks=False)  # -> Points, Tangents, Parameters
list_item_2 = ListItem(List=divide_curve.Points, Index=index, Wrap=True)
xz_plane = XZPlane(Origin=list_item_2)
scale_nu = ScaleNU(Geometry=flatten(relay), Plane=flatten(xz_plane), ScaleX=1, ScaleY=scale_y, ScaleZ=scale_z)  # -> Geometry, Transform

# ----
geometry = ClusterOutput(scale_nu.Geometry)

# ==== cluster Cluster_8
relay = ClusterInput()
index = ClusterInput()
scale_x = ClusterInput()
scale_y = ClusterInput()
scale_z = ClusterInput()

# ---- group: type A toilets
deconstruct_brep = DeconstructBrep(Brep=flatten(relay))  # -> Faces, Edges, Vertices
list_item = ListItem(List=deconstruct_brep.Edges, Index=0, Wrap=True)  # -> Item, Item1, Item2, Item3
curve_middle = CurveMiddle(Curve=list_item.Item1)
curve_middle_2 = CurveMiddle(Curve=list_item.Item3)
line = Line(StartPoint=curve_middle, EndPoint=curve_middle_2)
divide_curve = DivideCurve(Curve=line, Count=10, Kinks=False)  # -> Points, Tangents, Parameters
list_item_2 = ListItem(List=divide_curve.Points, Index=index, Wrap=True)
xz_plane = XZPlane(Origin=list_item_2)
scale_nu = ScaleNU(Geometry=flatten(relay), Plane=flatten(xz_plane), ScaleX=scale_x, ScaleY=scale_y, ScaleZ=scale_z)  # -> Geometry, Transform

# ----
geometry = ClusterOutput(scale_nu.Geometry)

# ==== cluster Cluster_9
relay = ClusterInput()
index = ClusterInput()
scale_x = ClusterInput()

# ---- group: type A toilets
deconstruct_brep = DeconstructBrep(Brep=flatten(relay))  # -> Faces, Edges, Vertices
list_item = ListItem(List=deconstruct_brep.Edges, Index=0, Wrap=True)  # -> Item, Item1, Item2, Item3
curve_middle = CurveMiddle(Curve=list_item.Item2)
curve_middle_2 = CurveMiddle(Curve=list_item.Item)
line = Line(StartPoint=curve_middle_2, EndPoint=curve_middle)
divide_curve = DivideCurve(Curve=line, Count=10, Kinks=False)  # -> Points, Tangents, Parameters
list_item_2 = ListItem(List=divide_curve.Points, Index=index, Wrap=True)
xz_plane = XZPlane(Origin=list_item_2)
scale_nu = ScaleNU(Geometry=flatten(relay), Plane=flatten(xz_plane), ScaleX=scale_x, ScaleY=1, ScaleZ=1)  # -> Geometry, Transform

# ----
geometry = ClusterOutput(scale_nu.Geometry)

# ==== cluster Cluster_10
surface = Surface(<surface referenced from the Rhino model>)
geometry = ClusterInput()
relay = ClusterInput()
mirror_surface = MirrorSurface(Geometry=geometry, Surface=surface, Frame=True)
surface_2 = Surface(<surface referenced from the Rhino model>)
relay_2 = ClusterOutput(relay)
mirror_surface_2 = MirrorSurface(Geometry=relay, Surface=surface_2, Frame=True)
geometry_2 = ClusterOutput(mirror_surface)
geometry_3 = ClusterOutput(mirror_surface_2)
